# Grasshopper definition MolaInCSharpExamples.gh (Grasshopper 1.0.7)
# plug-ins: HDMolaGH

# ---- group: BoxGrid
boxgrid = CSharpScript(
    x=Slider(5, range=0..10),
    y=Slider(3, range=0..10),
    z=Slider(2, range=0..10),
    u=Slider(4, range=0..10),
    h=Slider(8.3, range=0..10),
    Reference=["/Users/yang/Library/Application Support/McNeel/Rhinoceros/7.0/Plug-ins/Grasshopper (b45a29b1-4343-4035-989e-044e8580d9cf)/Libraries/netstandard.dll", "/Users/yang/Library/Application Support/McNeel/Rhinoceros/7.0/Plug-ins/Grasshopper (b45a29b1-4343-4035-989e-044e8580d9cf)/Libraries/HDMola.dll"])  # -> out, A; inputs x: Double, y: Double, z: Double, u: Int32, h: Double
# ---------- boxgrid: C# usings ----------
using Mola;
# ---------- boxgrid: C# ----------
MolaMesh mesh = MeshFactory.CreateBox(0, 0, 0, (float)x, (float)y, (float)z);
mesh = MeshSubdivision.Grid(mesh, u, u);
mesh = MeshSubdivision.ExtrudeToPointCenter(mesh, (float)h);
mesh = MeshTools.WeldVertices(mesh);
mesh = MeshTools.UpdateTopology(mesh);
mesh = MeshSubdivision.CatmullClark(mesh);
mesh = MeshSubdivision.CatmullClark(mesh);

Print(mesh.FacesCount().ToString());
Print(mesh.VertexCount().ToString());

A = mesh;
# ---------- end boxgrid ----------
to_rhino = MolaToRhino(MolaMesh=boxgrid.A, WithColor=True)

# ---- group: Boxes
boxes = CSharpScript(
    x=Slider(1, range=0..10),
    y=Slider(0.6, range=0..1),
    Reference=["/Users/yang/Library/Application Support/McNeel/Rhinoceros/7.0/Plug-ins/Grasshopper (b45a29b1-4343-4035-989e-044e8580d9cf)/Libraries/HDMola.dll", "/Users/yang/Library/Application Support/McNeel/Rhinoceros/7.0/Plug-ins/Grasshopper (b45a29b1-4343-4035-989e-044e8580d9cf)/Libraries/netstandard.dll"])  # -> out, A; inputs x: Double, y: Double
# ---------- boxes: C# ----------
MolaMesh mesh = MeshFactory.CreateBox();
//mesh = MeshSubdivision.Extrude(mesh, 0.5f, true);
mesh = MeshSubdivision.Extrude(mesh, (float)x, true);
mesh = MeshSubdivision.Extrude(mesh, (float)x, true);

mesh = MeshSubdivision.ExtrudeTapered(mesh, 0.2f, (float)y, false);

A = mesh;
# ---------- end boxes ----------
to_rhino_2 = MolaToRhino(MolaMesh=boxes.A, WithColor=True)

# ---- group: Sphere
sphere = CSharpScript(
    radius=Slider(3, range=0..5),
    u=Slider(3, range=0..10),
    v=Slider(7, range=0..10),
    Reference=["/Users/yang/Library/Application Support/McNeel/Rhinoceros/7.0/Plug-ins/Grasshopper (b45a29b1-4343-4035-989e-044e8580d9cf)/Libraries/netstandard.dll", "/Users/yang/Library/Application Support/McNeel/Rhinoceros/7.0/Plug-ins/Grasshopper (b45a29b1-4343-4035-989e-044e8580d9cf)/Libraries/HDMola.dll"])  # -> out, A; inputs radius: Double, u: Int32, v: Int32
# ---------- sphere: C# ----------
MolaMesh mesh = MeshFactory.CreateSphere((float)radius, 0, 0, 0, u, v);
A = mesh;
# ---------- end sphere ----------
to_rhino_3 = MolaToRhino(MolaMesh=sphere.A, WithColor=Toggle(True))

# ---- group: Box
# To run this script:
# 1) Download 3 files from: https://moodle-app2.let.ethz.ch/mod/folder/view.php?id=1026980
# 2) Locate those 3 files in the grasshopper components folder
# 3) Right click each C# nodes —> manage assembllies —> add—> choose Mola.dll and netstandard.dll to add as assemblies.
number_slider = Slider(1, range=0..10)
box = CSharpScript(
    x=number_slider,
    y=Slider(10, range=0..10),
    z=Slider(5, range=0..10),
    Reference=["/Users/yang/Library/Application Support/McNeel/Rhinoceros/7.0/Plug-ins/Grasshopper (b45a29b1-4343-4035-989e-044e8580d9cf)/Libraries/HDMola.dll", "/Users/yang/Library/Application Support/McNeel/Rhinoceros/7.0/Plug-ins/Grasshopper (b45a29b1-4343-4035-989e-044e8580d9cf)/Libraries/netstandard.dll"])  # -> out, A; inputs x: Double, y: Double, z: Double
# ---------- box: C# ----------
MolaMesh mesh = MeshFactory.CreateBox();
//mesh = MeshFactory.CreateBox(0, 0, 0, 2, 2, 2);
mesh = MeshFactory.CreateBox(0, 0, 0, (float)x, (float)y, (float)z);
A = mesh;
# ---------- end box ----------
to_rhino_4 = MolaToRhino(MolaMesh=box.A, WithColor=Toggle(True))

# ---- group: SphereFrame
sphereframe = CSharpScript(Reference=["/Users/yang/Library/Application Support/McNeel/Rhinoceros/7.0/Plug-ins/Grasshopper (b45a29b1-4343-4035-989e-044e8580d9cf)/Libraries/netstandard.dll", "/Users/yang/Library/Application Support/McNeel/Rhinoceros/7.0/Plug-ins/Grasshopper (b45a29b1-4343-4035-989e-044e8580d9cf)/Libraries/HDMola.dll"])  # -> out, A
# ---------- sphereframe: C# ----------
MolaMesh mesh = MeshFactory.CreateSphere();
mesh = MeshSubdivision.ExtrudeTapered(mesh, 0.2f, 0.5f, false);
mesh = MeshTools.WeldVertices(mesh);
mesh = MeshTools.UpdateTopology(mesh); 
mesh = MeshTools.Offset(mesh, 0.2f);

A = mesh;
# ---------- end sphereframe ----------
to_rhino_5 = MolaToRhino(MolaMesh=sphereframe.A, WithColor=True)

# ----
analysis = CSharpScript(
    x=box.A,
    Reference=["/Users/yang/Library/Application Support/McNeel/Rhinoceros/7.0/Plug-ins/Grasshopper (b45a29b1-4343-4035-989e-044e8580d9cf)/Libraries/netstandard.dll", "/Users/yang/Library/Application Support/McNeel/Rhinoceros/7.0/Plug-ins/Grasshopper (b45a29b1-4343-4035-989e-044e8580d9cf)/Libraries/HDMola.dll"])  # -> out, A
# ---------- analysis: C# ----------
MolaMesh mesh = (MolaMesh)x;
mesh = MeshSubdivision.Extrude(mesh, 0.5f, true);
mesh = MeshSubdivision.Extrude(mesh, 0.5f, true);
List<float> values = MeshAnalysis.FaceArea(mesh);
mesh = MeshTools.Color(mesh, values);
foreach(var item in values)
{
    Print(item.ToString());
}
A = mesh;
# ---------- end analysis ----------
to_rhino_6 = MolaToRhino(MolaMesh=analysis.A, WithColor=Toggle(True))
panel = Panel(boxgrid.out)
panel_2 = Panel(analysis.out)
